# Grasshopper definition column-placement.gh (Grasshopper 1.0.7)
# plug-ins: ScriptParasite, Moonlight

# You will need to set the assembly
# reference location to your copy of
# KangarooSolver.dll
# Do this by right-clicking and then
# Manage Assemblies
# "C:\Program Files\Rhino 7\Plug-ins\Grasshopper\Components\KangarooSolver.dll"
panel = Panel("C:\Users\danie\source\repos\column-placement")
crv = Curve(<curve referenced from the Rhino model>)
pt = Point([<point referenced from the Rhino model> x2])
crv_2 = Curve(<curve referenced from the Rhino model>)
moonlight = Moonlight(Mode=False)

c_script = CSharpScript(
    boundary=crv_2,
    offset=Slider(0.1, range=0..1),
    negative=crv,
    fixedColumns=pt,
    numberColumns=Slider(20, range=0..100),
    radius=Slider(1.5, range=0..10),
    Reference="C:\Program Files\Rhino 7\Plug-ins\Grasshopper\Components\KangarooSolver.dll")  # -> out, goals, iterations; inputs boundary: Curve, offset: Double, negative: list of Curve, fixedColumns: list of Point3d, numberColumns: Int32, fixedWalls: list, radius: Double
# ---------- c_script: C# usings ----------
using System.IO;
using System.Linq;
using System.Data;
using System.Drawing;
using System.Reflection;
using System.Windows;
using System.Xml;
using System.Xml.Linq;
using System.Runtime.InteropServices;
using Rhino.DocObjects;
using Rhino.Collections;
using GH_IO;
using GH_IO.Serialization;
using KangarooSolver;
using KangarooSolver.Goals;
# ---------- c_script: C# ----------
    /////////////////////////////
    //initialize the solver
    var PS = new KangarooSolver.PhysicalSystem();
    var allGoals = new List<IGoal>();

    ///////////////////////////
    //if offset is positive, then make it negative
    if (offset > 0)
    {
      offset = offset * -1;
    }

    //if offset != 0, then offset the boundary
    if (offset != 0)
    {
      boundary = boundary.Offset(Plane.WorldXY, offset, 0.5, CurveOffsetCornerStyle.Sharp)[0];
    }

    //array size is equal the size of negative list + 1
    Curve[] boundaryCurves = new Curve[negative.Count + 1];
    boundaryCurves[0] = boundary;
    for (int i = 0; i < negative.Count; i++)
    {
      boundaryCurves[i + 1] = negative[i];
    }

    //generate a surface with offseted boundary
    Brep brepBoundary = Brep.CreatePlanarBreps(boundaryCurves, 0.5)[0];

    //convert brep to mesh
    Mesh meshBoundary = Mesh.CreateFromBrep(brepBoundary, MeshingParameters.Default)[0];


    ///////////////////////////
    //find the center of the boundary
    Point3d center = brepBoundary.GetBoundingBox(false).Center;

    //create a circle at the center of the boundary
    Circle circle = new Circle(center, 0.1);

    //convert the circle to a nurbs curve
    Curve circleCurve = circle.ToNurbsCurve();

    //divide the circle into numberAddColumns
    int numberAddColumns = numberColumns - fixedColumns.Count;

    //create array for extra columns
    Point3d[] addColumns = new Point3d[numberAddColumns];
    double[] test = circleCurve.DivideByCount(numberAddColumns, true, out addColumns);

    //create a list of all columns
    List<Point3d> allColumns = addColumns.ToList();
    for (int i = 0; i < fixedColumns.Count; i++)
    {
      allColumns.Add(fixedColumns[i]);
    }

    ///////////////////////////
    //add goals to the list

    //onmesh goal
    OnMesh onMesh = new OnMesh(allColumns, meshBoundary, 1000);
    allGoals.Add(onMesh);

    //sphere collide goal
    SphereCollide sphereCollide = new SphereCollide(allColumns, radius, 1);
    allGoals.Add(sphereCollide);

    //anchor goal
    for (int i = 0; i < fixedColumns.Count; i++)
    {
      Anchor anchor = new Anchor(fixedColumns[i], 1000);
      allGoals.Add(anchor);
    }

    //add the goals to the solver
    foreach (IGoal goal in allGoals)
    {
      PS.AssignPIndex(goal, 0.0001);
      Print(goal.ToString());
    }

    int counter = 0;
    double threshold = 1e-15;

    do
    {
      //Step forward, using these goals, with multi-threading on, and stopping if the threshold is reached
      PS.Step(allGoals, true, threshold);
      counter++;
    } while (PS.GetvSum() > threshold && counter < 1000);

    //GetvSum returns the current kinetic energy
    //always include a counter to prevent it getting stuck forever in case it cannot reach the given threshold

    //get the positions of the points
    goals = PS.GetPositions();

    //get the number of iterations
    iterations = PS.GetIterations();
# ---------- end c_script ----------
scriptpar = ScriptParasite(Enable=Toggle(True), Folder=panel)

panel_2 = Panel(c_script.iterations)
panel_3 = Panel(c_script.out)
panel_4 = Panel(c_script.goals)
